# Grasshopper definition shortestpath.gh (Grasshopper 1.0.7)
# plug-ins: Shortest Walk in Gh, Human

curve = Curve([<curve referenced from the Rhino model> x59])
ghpython_script = GhPythonScript(network=curve, start=Slider(0, range=0..81), target=Slider(38, range=0..81))  # -> out, edges, shortestLine, vertices, c, v; inputs network: list of Curve, mesh: Mesh, start: Int32, target: Int32
# ---------- ghpython_script: Python ----------
__author__ = "Gizem Yetis"
__institution__ = "Middle East Technical University, Department of Architecture, Building Science"
__mail__ = "gizemyetis93@gmail.com"

import heapq
#from heapq import *

import sys
import rhinoscriptsyntax as rs
import itertools

from ghpythonutils.utils.utils import LineHelper, PointHelper


class Vertex:
    def __init__(self, geom):
        self.geom = geom
        self.adjacent = {}
        self.distance = sys.maxint     
        self.visited = False  
        self.previous = None

    def add_neighbor(self, neighbor, weight=0):
        self.adjacent[neighbor] = weight

    def get_connections(self):
        return self.adjacent.keys()  

    def get_geom(self):
        return self.geom

    def get_weight(self, neighbor):
        return self.adjacent[neighbor]

    def set_distance(self, dist):
        self.distance = dist

    def get_distance(self):
        return self.distance

    def set_previous(self, prev):
        self.previous = prev

    def set_visited(self):
        self.visited = True

    def __str__(self):
        return str(
            self.geom) + ' adjacent: ' + str([x.geom for x in self.adjacent]
        )

class Graph:
    def __init__(self):
        self.vert_dict = {}

    def __iter__(self):
        return iter(self.vert_dict.values())

    def add_vertex(self, geom):
        new_vertex = Vertex(geom)
        self.vert_dict[geom] = new_vertex

    def get_vertex(self, n):
        if n in self.vert_dict:
            return self.vert_dict[n]
        else:
            return None

    def add_edge(self, frm, to, cost = 0):
        self.vert_dict[frm].add_neighbor(self.vert_dict[to], cost)
        self.vert_dict[to].add_neighbor(self.vert_dict[frm], cost)

    def get_vertices(self):
        return self.vert_dict.keys()

    def set_previous(self, current):
        self.previous = current

    def get_previous(self, current):
        return self.previous

def shortpath(v, path):
    if v.previous:
        path.append(v.previous.get_geom())
        shortpath(v.previous, path)

def dijkstra(aGraph, start):
    start.set_distance(0)

    unvisited_queue = [(v.get_distance(),v) for v in aGraph]
    heapq.heapify(unvisited_queue)

    while len(unvisited_queue):
        uv = heapq.heappop(unvisited_queue)
        current = uv[1]
        current.set_visited()

        for next in current.adjacent:
            if next.visited:
                continue
            new_dist = current.get_distance() + current.get_weight(next)
            
            if new_dist < next.get_distance():
                next.set_distance(new_dist)
                next.set_previous(current)

        while len(unvisited_queue):
            heapq.heappop(unvisited_queue)
        unvisited_queue = [(v.get_distance(),v) for v in aGraph if not v.visited]
        heapq.heapify(unvisited_queue)


c, vertices = LineHelper.get_removed_overlapped_curves(network, True)

network = []
for curve in c:
    curve_start_point = curve.PointAtStart
    curve_end_point = curve.PointAtEnd
    
    data = []
    for vi, vertex in enumerate(vertices):
        if PointHelper.is_same_points(curve_start_point, vertex):
            data.append(vi)
        
        elif PointHelper.is_same_points(curve_end_point, vertex):
            data.append(vi)
            
        if len(data) == 2:
            break
            
    network.append([data, curve, curve.GetLength()])

g = Graph()

for v in range(len(vertices)):
    g.add_vertex(v)

for data in network:
    (start_index, end_index), edge, cost = data
    g.add_edge(start_index, end_index, cost)

for v in g:
    for w in v.get_connections():
        vid = v.get_geom()
        wid = w.get_geom()

dijkstra(g, g.get_vertex(start))

target = g.get_vertex(target)
path = [target.get_geom()]
shortpath(target, path)
print 'The shortest path : %s' %(path[::-1])

ptsLine = [vertices[p] for p in path]
if len(ptsLine) <= 1:
    shortestLine = []
else:
    shortestLine = rs.AddPolyline(ptsLine)
# ---------- end ghpython_script ----------
geometry = Geometry(ghpython_script.c)
geometry_2 = Geometry(ghpython_script.v)
curve_2 = Curve([<curve referenced from the Rhino model> x9])
custom_preview_lineweights = CustomPreviewLineweights(
    Geometry=ghpython_script.shortestLine,
    Shader={diffuse=RGB(255, 105, 180), emission=RGB(76, 32, 54), shine=0.5, specular=RGB(255, 255, 255), transparency=0},
    Thickness=5,
    Absolute=False)
length = Length(Curve=curve_2)
list_item = ListItem(List=curve_2, Index=Slider(8, range=0..8), Wrap=True)
point = Point(Point(256.7085585, 76.68409447, 0))
point_2 = Point(Point(270.7319356, 97.62977543, 0))
line = Line(StartPoint=point, EndPoint=point_2)
shortest_walk = ShortestWalk(Curves=curve_2, Lengths=length, WantedPath=line)  # -> ShortestWalk, Succession, Direction, Length
custom_preview_lineweights_2 = CustomPreviewLineweights(
    Geometry=shortest_walk.ShortestWalk,
    Shader={diffuse=RGB(255, 105, 180), emission=RGB(76, 32, 54), shine=0.5, specular=RGB(255, 255, 255), transparency=0},
    Thickness=5,
    Absolute=False)
